# Grasshopper definition spheres and feilds.gh (Grasshopper 1.0.7)

charge = Slider(0.25, range=0..1)
point = Point([<point referenced from the Rhino model> x6])
distance_between_points = GetNumber(Slider(0.5, range=0..1), AtLeast=0, AtMost=1, Maximum=1, Minimum=0.1, Prompt="distance between points min .1 max 1")
grid_size_10_to_100 = GetInteger(Slider(20, range=10..100), AtLeast=1, AtMost=1, Maximum=100, Minimum=10)
points = GetPoint(point, AtLeast=5, AtMost=20, Realtime=True)
radius_of_the_spheres = GetNumber(charge, AtLeast=0, AtMost=1, Maximum=1, Minimum=0.1)
square = Square(Plane=PlaneXY(0, 0, 0), Size=distance_between_points, ExtentX=grid_size_10_to_100, ExtentY=grid_size_10_to_100)  # -> Cells, Points
decay = Slider(1.5, range=0..5)
multiplication = Multiplication(A=radius_of_the_spheres, B=Slider(2, range=0..10))
point_2 = Point(flatten(square.Points))
point_charge = PointCharge(Point=points, Charge=radius_of_the_spheres, Decay=decay)
merge_fields = MergeFields(Fields=point_charge)
evaluate_field = EvaluateField(Field=merge_fields, Point=point_2)  # -> Tensor, Strength
vector_length = VectorLength(Vector=evaluate_field.Tensor)
sphere = Sphere(Base=points, Radius=multiplication)
minimum = Minimum(A=vector_length, B=Slider(0.6, range=0..1))
amplitude = Amplitude(Vector=evaluate_field.Tensor, Amplitude=minimum)
move = Move(Geometry=point_2, Motion=amplitude)  # -> graft(Geometry), Transform
unflatten_tree = UnflattenTree(Tree=move.Geometry, Guide=square.Points)
flip_matrix = FlipMatrix(Data=unflatten_tree)
nurbs_curve = NurbsCurve(Vertices=unflatten_tree, Degree=3, Periodic=False)  # -> Curve, Length, Domain
nurbs_curve_2 = NurbsCurve(Vertices=flip_matrix, Degree=3, Periodic=False)  # -> Curve, Length, Domain
pipe = Pipe(Curve=[nurbs_curve.Curve, nurbs_curve_2.Curve], Radius=Slider(0.066, range=0..1), Caps=Slider(2, range=0..2))  # -> flatten(Pipe)
context_bake = ContextBake(Geometry=[pipe, sphere])
